# Grasshopper definition 01_GlideReflection.gh (Grasshopper 1.0.8)
# plug-ins: eleFront

gap_btw_panesl = Panel("1")
int_grid_rep = EleFrontDataDescription("6", ShiftDepth=0, isNameSet=True)
int_grid_rep_2 = EleFrontDataDescription(int_grid_rep, ShiftDepth=0, isNameSet=False)
int_gap_btw_panels = EleFrontDataDescription(gap_btw_panesl, ShiftDepth=0, isNameSet=True)
sqgrid = Square(Plane=PlaneXY(0, 0, 0), Size="50", ExtentX=int_grid_rep_2, ExtentY=int_grid_rep_2)  # -> Cells, Points
int_grid_rep_3 = EleFrontDataDescription(int_grid_rep, ShiftDepth=0, isNameSet=False)

# ---- group: Create horizontal divider
explode = Explode(Curve=sqgrid.Cells, Recursive=True)  # -> Segments, Vertices
dispatch = Dispatch(List=explode.Segments, DispatchPattern=[True, False])  # -> ListA, ListB
midpt = CurveMiddle(Curve=dispatch.ListB)
item = ListItem(List=dispatch.ListA, Index=0, Wrap=True)  # -> Item, Item1
flip = FlipCurve(Curve=item.Item)  # -> Curve, Flag
pline = PolyLine(Vertices=midpt, Closed=False)
merge = Merge(Data1=flip.Curve, Data2=item.Item1)
weave = Weave(Pattern=[0, 1], Stream0=merge, Stream1=pline, NullGaps=False)

# ----
int_gap_btw_panels_2 = EleFrontDataDescription(int_gap_btw_panels, ShiftDepth=0, isNameSet=True)
neg = Negative(Value=int_gap_btw_panels_2)
trim = TrimTree(Tree=weave, Depth=1)
tstat = TreeStatistics(Tree=trim)  # -> Paths, Length, Count
dispatch_2 = Dispatch(List=tstat.Paths, DispatchPattern=[True, False])  # -> ListA, ListB
branch = TreeBranch(Tree=trim, Path=dispatch_2.ListA, MaintainPaths=True)
branch_2 = TreeBranch(Tree=trim, Path=dispatch_2.ListB, MaintainPaths=True)
partition = PartitionList(List=branch, Size="3")
partition_2 = PartitionList(List=branch_2, Size="3")
item_2 = ListItem(List=partition, Index=0, Wrap=True)  # -> Item, Item1, Item2
line = Line(item_2.Item)
item_3 = ListItem(List=partition_2, Index=0, Wrap=True)  # -> Item, Item1, Item2
midpt_2 = CurveMiddle(Curve=item_2.Item1)
end = EndPoints(Curve=item_2.Item2)  # -> Start, End
end_2 = EndPoints(Curve=item_2.Item)  # -> Start, End
end_3 = EndPoints(Curve=line)  # -> Start, End
end_4 = EndPoints(Curve=item_2.Item1)  # -> Start, End
midpt_3 = CurveMiddle(Curve=item_2.Item1)
end_5 = EndPoints(Curve=item_2.Item2)  # -> Start, End

midpt_4 = CurveMiddle(Curve=item_3.Item)
end_6 = EndPoints(Curve=item_3.Item)  # -> Start, End

midpt_5 = CurveMiddle(Curve=item_3.Item2)
end_7 = EndPoints(Curve=item_3.Item2)  # -> Start, End

end_8 = EndPoints(Curve=item_3.Item1)  # -> Start, End
ln = Line(StartPoint=end_2.End, EndPoint=midpt_2)
ln_2 = Line(StartPoint=midpt_2, EndPoint=end_2.Start)
ln_3 = Line(StartPoint=end.End, EndPoint=midpt_2)
ln_4 = Line(StartPoint=midpt_2, EndPoint=end.Start)
merge_2 = Merge(Data1=item_2.Item, Data2=ln, Data3=ln_2)
merge_3 = Merge(Data1=item_2.Item2, Data2=ln_3, Data3=ln_4)
merge_4 = Merge(Data1=midpt_5, Data2=end_7.End, Data3=end_8.End)
merge_5 = Merge(Data1=end_8.End, Data2=end_8.Start, Data3=midpt_5)
merge_6 = Merge(Data1=end_6.End, Data2=midpt_4, Data3=end_8.End)
merge_7 = Merge(Data1=midpt_4, Data2=end_8.Start, Data3=end_8.End)
merge_8 = Merge(Data1=midpt_4, Data2=end_6.Start, Data3=end_8.Start)
merge_9 = Merge(Data1=end_7.Start, Data2=midpt_5, Data3=end_8.Start)
merge_10 = Merge(Data1=end_3.End, Data2=end_4.End, Data3=midpt_3)
merge_11 = Merge(Data1=midpt_3, Data2=end_4.Start, Data3=end_3.Start)
merge_12 = Merge(Data1=end_4.End, Data2=end_5.End, Data3=midpt_3)
merge_13 = Merge(Data1=midpt_3, Data2=end_5.Start, Data3=end_4.Start)

pline_2 = PolyLine(Vertices=merge_10, Closed=invert(False))
pline_3 = PolyLine(Vertices=merge_12, Closed=invert(False))
pline_4 = PolyLine(Vertices=merge_11, Closed=invert(False))
pline_5 = PolyLine(Vertices=merge_13, Closed=invert(False))
join = JoinCurves(Curves=merge_2, Preserve=False)
join_2 = JoinCurves(Curves=merge_3, Preserve=False)

entwine = Entwine(
    Branch0X=merge_6,
    Branch1X=merge_7,
    Branch2X=merge_8,
    Branch3X=merge_9,
    Branch4X=merge_5,
    Branch5X=merge_4,
    FlattenInputs=False)
int_grid_rep_4 = EleFrontDataDescription(int_grid_rep, ShiftDepth=0, isNameSet=False)

odd_column_sw_triangle = EleFrontDataDescription(simplify(pline_2), ShiftDepth=0, isNameSet=True)
odd_column_nw_triangle = EleFrontDataDescription(simplify(pline_3), ShiftDepth=0, isNameSet=True)
odd_column_ne_triangle = EleFrontDataDescription(simplify(pline_5), ShiftDepth=0, isNameSet=True)
odd_column_n_triangle = EleFrontDataDescription(simplify(join_2), ShiftDepth=0, isNameSet=True)
odd_column_se_triangle = EleFrontDataDescription(simplify(pline_4), ShiftDepth=0, isNameSet=True)
odd_column_s_triangle = EleFrontDataDescription(simplify(join), ShiftDepth=0, isNameSet=True)

division = Division(A=int_grid_rep_4, B=2)
pline_6 = PolyLine(Vertices=entwine, Closed=invert(False))  # -> simplify(Polyline)
multiplication = Multiplication(A=int_grid_rep_4, B=division)
trim_2 = TrimTree(Tree=pline_6, Depth=1)
odd_column_sw_triangle_2 = EleFrontDataDescription(odd_column_sw_triangle, ShiftDepth=0, isNameSet=False)
odd_column_nw_triangle_2 = EleFrontDataDescription(odd_column_nw_triangle, ShiftDepth=0, isNameSet=False)
odd_column_ne_triangle_2 = EleFrontDataDescription(odd_column_ne_triangle, ShiftDepth=0, isNameSet=False)
odd_column_n_triangle_2 = EleFrontDataDescription(odd_column_n_triangle, ShiftDepth=0, isNameSet=False)
odd_column_se_triangle_2 = EleFrontDataDescription(odd_column_se_triangle, ShiftDepth=0, isNameSet=False)
odd_column_s_triangle_2 = EleFrontDataDescription(odd_column_s_triangle, ShiftDepth=0, isNameSet=False)
path_mapper = PathMapper(trim_2, source="{A;B}(i)", target="{i;B}(a)")
merge_14 = Merge(
    Data1=odd_column_sw_triangle_2,
    Data2=odd_column_s_triangle_2,
    Data3=odd_column_se_triangle_2,
    Data4=odd_column_ne_triangle_2,
    Data5=odd_column_n_triangle_2,
    Data6=odd_column_nw_triangle_2)

crv_odd_column_triangles = EleFrontDataDescription(merge_14, ShiftDepth=0, isNameSet=True)
crv_odd_column_triangles_2 = EleFrontDataDescription(path_mapper, ShiftDepth=0, isNameSet=True)

crv_odd_column_triangles_3 = EleFrontDataDescription(crv_odd_column_triangles, ShiftDepth=0, isNameSet=False)
crv_odd_column_triangles_4 = EleFrontDataDescription(crv_odd_column_triangles_2, ShiftDepth=0, isNameSet=False)

entwine_2 = Entwine(Branch0X=crv_odd_column_triangles_3, Branch1X=crv_odd_column_triangles_4, FlattenInputs=False)
area = Area(Geometry=entwine_2)  # -> Area, Centroid
xy = XYPlane(Origin=area.Centroid)
offset = OffsetCurve(Curve=entwine_2, Distance=int_gap_btw_panels_2, Plane=xy, Corners=1)
offset_2 = OffsetCurve(Curve=entwine_2, Distance=neg, Plane=xy, Corners=1)
merge_15 = Merge(Data1=offset, Data2=offset_2)
sort = SortList(Keys=merge_15, ValuesA=merge_15)  # -> Keys, ValuesA
item_4 = ListItem(List=sort.ValuesA, Index=0, Wrap=True)
crv_offseted_panels = EleFrontDataDescription(item_4, ShiftDepth=0, isNameSet=True)
crv_offseted_panels_2 = EleFrontDataDescription(crv_offseted_panels, ShiftDepth=0, isNameSet=False)
crv_offseted_panels_3 = EleFrontDataDescription(crv_offseted_panels_2, ShiftDepth=0, isNameSet=False)
crv_offseted_panels_4 = EleFrontDataDescription(crv_offseted_panels_3, ShiftDepth=0, isNameSet=False)
trim_3 = TrimTree(Tree=crv_offseted_panels_4, Depth=1)
tstat_2 = TreeStatistics(Tree=trim_3)  # -> Paths, Length, Count
partition_3 = PartitionList(List=tstat_2.Paths, Size=multiplication)
flip_2 = FlipMatrix(Data=partition_3)
item_5 = ListItem(List=flip_2, Index=0, Wrap=True)  # -> Item, Item1
flip_3 = FlipMatrix(Data=item_5.Item)
flip_4 = FlipMatrix(Data=item_5.Item1)

branch_3 = TreeBranch(Tree=trim_3, Path=flip_3, MaintainPaths=True)
branch_4 = TreeBranch(Tree=trim_3, Path=flip_4, MaintainPaths=True)
