# Grasshopper definition 02_RadialFold.gh (Grasshopper 1.0.8)
# plug-ins: eleFront

cir = Circle(Plane=PlaneXY(0, 0, 0), Radius="50")
cir_2 = Circle(Plane=PlaneXY(0, 0, 0), Radius="100")
divide = DivideCurve(Curve=cir, Count="30", Kinks=False)  # -> Points, Tangents, Parameters
crv_cp = CurveClosestPoint(Point=divide.Points, Curve=cir_2)  # -> Point, Parameter, Distance
shatter = Shatter(Curve=cir, Parameters=divide.Parameters)
shatter_2 = Shatter(Curve=cir_2, Parameters=crv_cp.Parameter)
cull_i = CullIndex(List=shatter, Indices="0", Wrap=True)
cull_i_2 = CullIndex(List=shatter_2, Indices="0", Wrap=True)
join = JoinCurves(Curves=cull_i_2, Preserve=False)
join_2 = JoinCurves(Curves=cull_i, Preserve=False)
crv_outer_open_end_circle = EleFrontDataDescription(join, ShiftDepth=0, isNameSet=True)
crv_inner_open_end_circle = EleFrontDataDescription(join_2, ShiftDepth=0, isNameSet=True)
crv_inner_open_end_circle_2 = EleFrontDataDescription(crv_inner_open_end_circle, ShiftDepth=0, isNameSet=False)
crv_outer_open_end_circle_2 = EleFrontDataDescription(crv_outer_open_end_circle, ShiftDepth=0, isNameSet=False)
explode = Explode(Curve=crv_outer_open_end_circle_2, Recursive=True)  # -> Segments, Vertices
explode_2 = Explode(Curve=crv_inner_open_end_circle_2, Recursive=True)  # -> Segments, Vertices
vec2pt = Vector2Pt(PointA=explode_2.Vertices, PointB=explode.Vertices, Unitize=False)  # -> Vector, Length
Z = UnitZ(Factor=1)
ln = Line(StartPoint=explode_2.Vertices, EndPoint=explode.Vertices)
vrot = Rotate(Vector=vec2pt.Vector, Axis=Z, Angle="Pi/2")
panel = Panel("""-1
1""")
graft = GraftTree(Tree=ln, IncludeEmptyLists=True, IncludeNullItems=True)
graft_2 = GraftTree(Tree=vrot, IncludeEmptyLists=True, IncludeNullItems=True)
amp = Amplitude(Vector=graft_2, Amplitude=panel)
move = Move(Geometry=graft, Motion=amp)  # -> Geometry, Transform
tstat = TreeStatistics(Tree=move.Geometry)  # -> Paths, Length, Count
subtraction = Subtraction(A=tstat.Count, B=1)
item = ListItem(List=tstat.Paths, Index=0, Wrap=True)  # -> Item1, Item
cull_i_3 = CullIndex(List=tstat.Paths, Indices=subtraction, Wrap=True)
merge = Merge(Data1=item.Item, Data2=item.Item1)
cull_i_4 = CullIndex(List=cull_i_3, Indices="0", Wrap=True)
branch = TreeBranch(Tree=move.Geometry, Path=cull_i_4, MaintainPaths=True)
branch_2 = TreeBranch(Tree=graft, Path=merge, MaintainPaths=True)
merge_2 = Merge(Data1=branch, Data2=branch_2)

crv_outer_open_end_circle_3 = EleFrontDataDescription(crv_outer_open_end_circle, ShiftDepth=0, isNameSet=False)
crv_inner_open_end_circle_3 = EleFrontDataDescription(crv_inner_open_end_circle, ShiftDepth=0, isNameSet=False)

flatten = FlattenTree(Tree=merge_2, Path="{0}")
item_2 = ListItem(List=flatten, Index=0, Wrap=True)  # -> Item, Item1, Item2
end = EndPoints(Curve=flatten)  # -> Start, End
crv_cp_2 = CurveClosestPoint(Point=end.End, Curve=crv_outer_open_end_circle_3)  # -> Point, Parameter, Distance
crv_cp_3 = CurveClosestPoint(Point=end.Start, Curve=crv_inner_open_end_circle_3)  # -> Point, Parameter, Distance
neg = Negative(Value=crv_cp_2.Distance)
ext = ExtendCurve(Curve=flatten, Type=0, Start=crv_cp_3.Distance, End=neg)
shatter_3 = Shatter(Curve=crv_inner_open_end_circle_3, Parameters=crv_cp_3.Parameter)
shatter_4 = Shatter(Curve=crv_outer_open_end_circle_3, Parameters=crv_cp_2.Parameter)
dispatch = Dispatch(List=shatter_4, DispatchPattern=[True, False])  # -> ListA, ListB
dispatch_2 = Dispatch(List=shatter_3, DispatchPattern=[True, False])  # -> ListA, ListB
partition = PartitionList(List=ext, Size="2")  # -> simplify(Chunks)
graft_3 = GraftTree(Tree=dispatch_2.ListA, IncludeEmptyLists=True, IncludeNullItems=True)  # -> simplify(Tree)
graft_4 = GraftTree(Tree=dispatch.ListA, IncludeEmptyLists=True, IncludeNullItems=True)  # -> simplify(Tree)
merge_3 = Merge(Data1=partition, Data2=graft_3, Data3=graft_4)
branch_3 = TreeBranch(Tree=merge_3, Path="{0}", MaintainPaths=True)
join_3 = JoinCurves(Curves=merge_3, Preserve=False)
