# Grasshopper definition 03_Hubermann.gh (Grasshopper 1.0.8)
# plug-ins: eleFront

panel = Panel("crv;outer_circle")
xy = XYPlane(Origin=Point(0, 0, 0))
X = UnitX(Factor=1)
number_slider = Slider(3, range=0..50)
bridgewidth = Panel("2")
number_slider_2 = Slider(15, range=10..20)
bridgethk = Panel("4")

int_bridge_wdith = EleFrontDataDescription(bridgewidth, ShiftDepth=0, isNameSet=True)
int_bridge_thk = EleFrontDataDescription(bridgethk, ShiftDepth=0, isNameSet=True)
cir = Circle(Plane=PlaneXY(0, 0, 0), Radius="160")
cir_2 = Circle(Plane=PlaneXY(0, 0, 0), Radius="180")
cir_3 = Circle(Plane=PlaneXY(0, 0, 0), Radius="200")

line = LineSDL(Start=xy, Direction=X, Length="200")
int_bridge_thk_2 = EleFrontDataDescription(int_bridge_thk, ShiftDepth=0, isNameSet=False)
crv_mddle_circle = EleFrontDataDescription(cir_2, ShiftDepth=0, isNameSet=True)
crv_outer_circle = EleFrontDataDescription(cir_3, ShiftDepth=0, isNameSet=True)
crv_inner_circle = EleFrontDataDescription(cir, ShiftDepth=0, isNameSet=True)
multiplication = Multiplication(A=number_slider, B=2)
int_bridge_thk_3 = EleFrontDataDescription(int_bridge_thk_2, ShiftDepth=0, isNameSet=False)
arrpolar = PolarArray(Geometry=line, Plane=PlaneXY(0, 0, 0), Count=multiplication, Angle=6.283185307)  # -> Geometry, Transform
crv_mddle_circle_2 = EleFrontDataDescription(crv_mddle_circle, ShiftDepth=0, isNameSet=False)
crv_inner_circle_2 = EleFrontDataDescription(crv_inner_circle, ShiftDepth=0, isNameSet=False)
crv_outer_circle_2 = EleFrontDataDescription(crv_outer_circle, ShiftDepth=0, isNameSet=False)
dispatch = Dispatch(List=arrpolar.Geometry, DispatchPattern=[True, False])  # -> ListA, ListB
line_middle_constraint = EleFrontDataDescription(dispatch.ListB, ShiftDepth=0, isNameSet=False)
entwine = Entwine(Branch00=crv_inner_circle_2, Branch01=crv_outer_circle_2, FlattenInputs=True)
arrpolar_2 = PolarArray(Geometry=line, Plane=PlaneXY(0, 0, 0), Count=number_slider, Angle=6.283185307)  # -> Geometry, Transform
crv_inner_outer_circle = EleFrontDataDescription(entwine, ShiftDepth=0, isNameSet=True)

line_middle_constraint_2 = EleFrontDataDescription(line_middle_constraint, ShiftDepth=0, isNameSet=True)
line_end_constraint = EleFrontDataDescription(arrpolar_2.Geometry, ShiftDepth=0, isNameSet=True)

line_end_constraint_2 = EleFrontDataDescription(line_end_constraint, ShiftDepth=0, isNameSet=False)
crv_inner_outer_circle_2 = EleFrontDataDescription(crv_inner_outer_circle, ShiftDepth=0, isNameSet=False)
crv_mddle_circle_3 = EleFrontDataDescription(crv_mddle_circle, ShiftDepth=0, isNameSet=False)
crvprox = CurveProximity(CurveA=crv_inner_outer_circle_2, CurveB=line_end_constraint_2)  # -> PointA, PointB, Distance
crvprox_2 = CurveProximity(CurveA=crv_mddle_circle_3, CurveB=line_middle_constraint_2)  # -> PointA, PointB, Distance
path_mapper = PathMapper(crvprox.PointA, source="{A;B}\t", target="{A;2*B}")
tstat = TreeStatistics(Tree=crvprox.PointA)  # -> Paths, Length, Count
dispatch_2 = Dispatch(List=tstat.Paths, DispatchPattern=[True, False])  # -> ListA, ListB
panel_2 = Panel(path_mapper)
branch = TreeBranch(Tree=crvprox.PointA, Path=dispatch_2.ListB, MaintainPaths=True)
branch_2 = TreeBranch(Tree=crvprox.PointA, Path=dispatch_2.ListA, MaintainPaths=True)
shift = ShiftList(List=branch_2, Shift="-1", Wrap=True)  # -> simplify(List)
shift_2 = ShiftList(List=branch_2, Shift=1, Wrap=True)  # -> simplify(List)
pshift = ShiftPaths(Data=shift, Offset=-1)
pshift_2 = ShiftPaths(Data=shift_2, Offset=-1)
path_mapper_2 = PathMapper(crvprox_2.PointA, source="{A;B}\t", target="{A;2*B+1}")
merge = Merge(Data1=pshift, Data2=branch)
merge_2 = Merge(Data1=pshift_2, Data2=branch)
path_mapper_3 = PathMapper(merge, source="{A;B}\t", target="{A;2*B}")
path_mapper_4 = PathMapper(merge_2, source="{A;B}\t", target="{A;2*B}")
shift_3 = ShiftList(List=path_mapper_2, Shift="-1", Wrap=True)
pshift_3 = ShiftPaths(Data=shift_3, Offset=-1)
merge_3 = Merge(Data1=path_mapper_3, Data2=pshift_3)
merge_4 = Merge(Data1=path_mapper_4, Data2=path_mapper_2)
flip = FlipMatrix(Data=merge_3)
flip_2 = FlipMatrix(Data=merge_4)
item = ListItem(List=flip, Index=0, Wrap=True)  # -> Item, Item1, Item2
int_bridge_thk_4 = EleFrontDataDescription(int_bridge_thk_3, ShiftDepth=0, isNameSet=False)
item_2 = ListItem(List=flip_2, Index=0, Wrap=True)  # -> Item, Item1, Item2
arc = Arc3Pt(PointA=item_2.Item, PointB=item_2.Item1, PointC=item_2.Item2)  # -> Arc, Plane, Radius
Z = UnitZ(Factor=int_bridge_thk_4)
arc_2 = Arc3Pt(PointA=item.Item, PointB=item.Item1, PointC=item.Item2)  # -> Arc, Plane, Radius

move = Move(Geometry=arc.Arc, Motion=Z)  # -> Geometry, Transform
move_2 = Move(Geometry=flip_2, Motion=Z)  # -> Geometry, Transform

int_bridge_wdith_2 = EleFrontDataDescription(int_bridge_wdith, ShiftDepth=0, isNameSet=False)
entwine_2 = Entwine(Branch00=move.Geometry, Branch01=arc_2.Arc, FlattenInputs=True)
entwine_3 = Entwine(Branch00=move_2.Geometry, Branch01=flip, FlattenInputs=True)
neg = Negative(Value=int_bridge_wdith_2)
merge_5 = Merge(Data1=int_bridge_wdith_2, Data2=neg)
graft = GraftTree(Tree=entwine_2, IncludeEmptyLists=True, IncludeNullItems=True)
partition = PartitionList(List=entwine_3, Size="3")

crv_moved_center_curve = EleFrontDataDescription(graft, ShiftDepth=0, isNameSet=True)
pts_moved_points = EleFrontDataDescription(partition, ShiftDepth=0, isNameSet=True)

pts_moved_points_2 = EleFrontDataDescription(pts_moved_points, ShiftDepth=0, isNameSet=False)
crv_moved_center_curve_2 = EleFrontDataDescription(crv_moved_center_curve, ShiftDepth=0, isNameSet=False)
item_3 = ListItem(List=pts_moved_points_2, Index=0, Wrap=True)  # -> Item, Item1, Item2
int_bridge_wdith_3 = EleFrontDataDescription(int_bridge_wdith, ShiftDepth=0, isNameSet=False)
multiplication_2 = Multiplication(A=int_bridge_wdith_3, B=1.5)
offset = OffsetCurve(Curve=crv_moved_center_curve_2, Distance=merge_5, Corners=1)
merge_6 = Merge(Data1=item_3.Item, Data2=item_3.Item1, Data3=item_3.Item2)
int_joint_outer_rad = EleFrontDataDescription(multiplication_2, ShiftDepth=0, isNameSet=True)
pt_joint_center = EleFrontDataDescription(merge_6, ShiftDepth=0, isNameSet=True)
int_joint_outer_rad_2 = EleFrontDataDescription(int_joint_outer_rad, ShiftDepth=0, isNameSet=False)
pt_joint_center_2 = EleFrontDataDescription(pt_joint_center, ShiftDepth=0, isNameSet=False)
trim = TrimTree(Tree=offset, Depth=1)
circle = CircleCNR(Center=pt_joint_center_2, Normal=Vector(0, 0, 1), Radius=int_joint_outer_rad_2)
Z_2 = UnitZ(Factor=1)
item_4 = ListItem(List=trim, Index=0, Wrap=True)  # -> Item, Item1
Z_3 = UnitZ(Factor="-2")
move_3 = Move(Geometry=circle, Motion=Z_2)  # -> Geometry, Transform
extr = Extrude(Base=move_3.Geometry, Direction=Z_3)
scx = SurfaceCurve(Surface=extr, Curve=item_4.Item1)  # -> Curves, Points, UVPoints, Normals, Parameters, Tangents
scx_2 = SurfaceCurve(Surface=extr, Curve=item_4.Item)  # -> Curves, Points, UVPoints, Normals, Parameters, Tangents
trim_2 = TrimTree(Tree=scx.Parameters, Depth=1)
trim_3 = TrimTree(Tree=scx_2.Parameters, Depth=1)
merge_7 = Merge(Data1=scx_2.Points, Data2=scx.Points)
graft_2 = GraftTree(Tree=circle, IncludeEmptyLists=True, IncludeNullItems=True)
shatter = Shatter(Curve=item_4.Item, Parameters=trim_3)
shatter_2 = Shatter(Curve=item_4.Item1, Parameters=trim_2)
crv_cp = CurveClosestPoint(Point=merge_7, Curve=graft_2)  # -> Point, Parameter, Distance
sort = SortList(Keys=shatter, ValuesA=shatter)  # -> Keys, reverse(ValuesA)
sort_2 = SortList(Keys=shatter_2, ValuesA=shatter_2)  # -> Keys, reverse(ValuesA)
item_5 = ListItem(List=sort_2.ValuesA, Index=0, Wrap=True)  # -> Item, Item1
item_6 = ListItem(List=sort.ValuesA, Index=0, Wrap=True)  # -> Item, Item1
shatter_3 = Shatter(Curve=graft_2, Parameters=crv_cp.Parameter)  # -> simplify(Segments)
merge_8 = Merge(Data1=item_6.Item, Data2=item_6.Item1)  # -> simplify(Result)
merge_9 = Merge(Data1=item_5.Item, Data2=item_5.Item1)  # -> simplify(Result)
tstat_2 = TreeStatistics(Tree=shatter_3)  # -> Paths, Length, Count

crv_long_edge_1 = EleFrontDataDescription(merge_8, ShiftDepth=0, isNameSet=True)
crv_long_edge_2 = EleFrontDataDescription(merge_9, ShiftDepth=0, isNameSet=True)

equals = Equality(FirstNumber=tstat_2.Length, SecondNumber=2)  # -> Equality, Inequality
dispatch_3 = Dispatch(List=tstat_2.Paths, DispatchPattern=equals.Equality)  # -> ListA, ListB
pts_moved_points_3 = EleFrontDataDescription(pts_moved_points, ShiftDepth=0, isNameSet=False)
crv_moved_center_curve_3 = EleFrontDataDescription(crv_moved_center_curve, ShiftDepth=0, isNameSet=False)
branch_3 = TreeBranch(Tree=shatter_3, Path=dispatch_3.ListA, MaintainPaths=True)
branch_4 = TreeBranch(Tree=shatter_3, Path=dispatch_3.ListB, MaintainPaths=True)
item_7 = ListItem(List=pts_moved_points_3, Index="1", Wrap=True)
sort_3 = SortList(Keys=branch_3, ValuesA=branch_3)  # -> Keys, reverse(ValuesA)
crv_cp_2 = CurveClosestPoint(Point=item_7, Curve=crv_moved_center_curve_3)  # -> Point, Parameter, Distance
pframe = PerpFrame(Curve=crv_moved_center_curve_3, Parameter=crv_cp_2.Parameter)
pcx = CurvePlane(Curve=branch_4, Plane=pframe)  # -> Points, ParamsC, ParamsP
graft_3 = GraftTree(Tree=branch_4, IncludeEmptyLists=True, IncludeNullItems=True)
tstat_3 = TreeStatistics(Tree=pcx.Points)  # -> Paths, Length, Count
dispatch_4 = Dispatch(List=tstat_3.Paths, DispatchPattern=tstat_3.Length)  # -> ListA, ListB
branch_5 = TreeBranch(Tree=graft_3, Path=dispatch_4.ListA, MaintainPaths=True)
item_8 = ListItem(List=sort_3.ValuesA, Index=0, Wrap=True)

crv_bridge_end_round = EleFrontDataDescription(item_8, ShiftDepth=0, isNameSet=True)
crv_bridge_middle_round = EleFrontDataDescription(branch_5, ShiftDepth=0, isNameSet=True)

crv_bridge_end_round_2 = EleFrontDataDescription(crv_bridge_end_round, ShiftDepth=0, isNameSet=False)
crv_bridge_middle_round_2 = EleFrontDataDescription(crv_bridge_middle_round, ShiftDepth=0, isNameSet=False)
crv_long_edge_1_2 = EleFrontDataDescription(crv_long_edge_1, ShiftDepth=0, isNameSet=False)
crv_long_edge_2_2 = EleFrontDataDescription(crv_long_edge_2, ShiftDepth=0, isNameSet=False)
int_joint_outer_rad_3 = EleFrontDataDescription(int_joint_outer_rad, ShiftDepth=0, isNameSet=False)
trim_4 = TrimTree(Tree=crv_bridge_middle_round_2, Depth="2")
trim_5 = TrimTree(Tree=crv_bridge_end_round_2, Depth=1)
pt_joint_center_3 = EleFrontDataDescription(pt_joint_center, ShiftDepth=0, isNameSet=False)
division = Division(A=int_joint_outer_rad_3, B=3)
multiplication_3 = Multiplication(A=division, B=Slider(1.5, range=0..10))
circle_2 = CircleCNR(Center=pt_joint_center_3, Normal=Vector(0, 0, 1), Radius=multiplication_3)  # -> simplify(Circle)
merge_10 = Merge(Data1=crv_long_edge_1_2, Data2=crv_long_edge_2_2, Data3=trim_5, Data4=trim_4, Data5=circle_2)
join = JoinCurves(Curves=merge_10, Preserve=False)
boundary = BoundarySurfaces(Edges=join)
int_bridge_thk_5 = EleFrontDataDescription(int_bridge_thk_2, ShiftDepth=0, isNameSet=False)
Z_4 = UnitZ(Factor=int_bridge_thk_5)
extr_2 = Extrude(Base=boundary, Direction=Z_4)
