# Grasshopper definition 04_radialfolding.gh (Grasshopper 1.0.8)
# plug-ins: eleFront

number_slider = Slider(10, range=0..200)
number_slider_2 = Slider(118, range=0..200)
subtraction = Subtraction(A=number_slider_2, B=number_slider)
X = UnitX(Factor=1)
pt = ConstructPoint(XCoordinate=number_slider, YCoordinate=0, ZCoordinate=0)

cir = Circle(Plane=PlaneXY(0, 0, 0), Radius=number_slider_2)
line = LineSDL(Start=pt, Direction=X, Length=subtraction)
cir_2 = Circle(Plane=PlaneXY(0, 0, 0), Radius=number_slider)

arrpolar = PolarArray(Geometry=line, Plane=PlaneXY(0, 0, 0), Count=Slider(12, range=5..30), Angle=6.283185307)  # -> Geometry, Transform
crv_base_radial_line = EleFrontDataDescription(arrpolar.Geometry, ShiftDepth=0, isNameSet=True)
crv_base_radial_line_2 = EleFrontDataDescription(crv_base_radial_line, ShiftDepth=0, isNameSet=False)
divide = DivideCurve(Curve=crv_base_radial_line_2, Count=10, Kinks=False)  # -> Points, Tangents, Parameters
dash = DashPattern(Curve=crv_base_radial_line_2, Pattern="2")  # -> Dashes, Gaps
tstat = TreeStatistics(Tree=dash.Dashes)  # -> Paths, Length, Count
dispatch = Dispatch(List=tstat.Paths, DispatchPattern=[True, False])  # -> ListA, ListB
flip = FlipMatrix(Data=divide.Points)
pline = PolyLine(Vertices=flip, Closed=invert(False))
branch = TreeBranch(Tree=dash.Dashes, Path=dispatch.ListA, MaintainPaths=True)
branch_2 = TreeBranch(Tree=dash.Dashes, Path=dispatch.ListB, MaintainPaths=True)
dispatch_2 = Dispatch(List=branch, DispatchPattern=[True, False])  # -> ListA, ListB
dispatch_3 = Dispatch(List=branch_2, DispatchPattern=[True, False])  # -> ListA, ListB

crv_radialbase2 = EleFrontDataDescription(dispatch_3.ListB, ShiftDepth=0, isNameSet=True)
crv_radialbase1 = EleFrontDataDescription(dispatch_2.ListA, ShiftDepth=0, isNameSet=True)

crv_radialbase2_2 = EleFrontDataDescription(simplify(crv_radialbase2), ShiftDepth=0, isNameSet=False)
crv_radialbase1_2 = EleFrontDataDescription(crv_radialbase1, ShiftDepth=0, isNameSet=False)

lng = ListLength(List=crv_radialbase1_2)
subtraction_2 = Subtraction(A=lng, B=1)
item = ListItem(List=crv_radialbase1_2, Index=0, Wrap=True)  # -> Item1, Item
ins = InsertItems(List=subtraction_2, Item="0", Indices="0", Wrap=True)
cull_i = CullIndex(List=crv_radialbase1_2, Indices=ins, Wrap=True)
crv = Curve(item.Item1)
graft = GraftTree(Tree=cull_i, IncludeEmptyLists=True, IncludeNullItems=True)
merge = Merge(Data1=graft, Data2=graft)  # -> simplify(Result)
trim = TrimTree(Tree=merge, Depth=1)
merge_2 = Merge(Data1=simplify(item.Item), Data2=simplify(trim), Data3=simplify(item.Item1))
crv_radialbase2_3 = EleFrontDataDescription(crv_radialbase2_2, ShiftDepth=0, isNameSet=False)
path_mapper = PathMapper(crv_radialbase2_3, source="{A}", target="{A-1}")
item_2 = ListItem(List=merge_2, Index=0, Wrap=True)
graft_2 = GraftTree(Tree=path_mapper, IncludeEmptyLists=True, IncludeNullItems=True)
partition = PartitionList(List=merge_2, Size="2")
item_3 = ListItem(List=partition, Index=0, Wrap=True)  # -> Item, Item1
end = EndPoints(Curve=graft_2)  # -> Start, End
end_2 = EndPoints(Curve=item_3.Item1)  # -> Start, End
end_3 = EndPoints(Curve=item_3.Item)  # -> Start, End
crv_base_radial_line_3 = EleFrontDataDescription(crv_base_radial_line, ShiftDepth=0, isNameSet=False)
ln = Line(StartPoint=end_3.Start, EndPoint=end.Start)
ln_2 = Line(StartPoint=end_2.Start, EndPoint=end.End)
dispatch_4 = Dispatch(List=crv_base_radial_line_3, DispatchPattern=[True, False])  # -> ListA, ListB
trim_2 = TrimTree(Tree=ln, Depth=1)
graft_3 = GraftTree(Tree=dispatch_4.ListA, IncludeEmptyLists=True, IncludeNullItems=True)
mirror = Mirror(Plane=PlaneYZ(0, 0, 0))  # -> Geometry, Transform
rotax = RotateAxis(Geometry=ln_2, Angle="Pi", Axis=graft_3)  # -> Geometry, Transform
rotax_2 = RotateAxis(Geometry=trim_2, Angle="Pi", Axis=graft_3)  # -> Geometry, Transform
